# Dynamo graph Improved wall extraction.dyn (Dynamo 2.18.1.5096)

file_path = Filename(".\walls_data.csv")

# group: Get Walls
categories = Categories("OST_Walls")
all_elements_of_category = ElementsOfCategory(Category=categories)

# group: Get Wall ID
code_block = CodeBlock { "ID"; }
id = Element.Id(element=all_elements_of_category)
list_create = List.Create(item0=code_block, item1=id)
flatten = List.Flatten(list=list_create)

# group: Get Wall Length
code_block_2 = CodeBlock { "Length"; }
getParameterValueByName = Element.GetParameterValueByName(element=all_elements_of_category, parameterName=code_block_2)
list_create_2 = List.Create(item0=code_block_2, item1=getParameterValueByName)
flatten_2 = List.Flatten(list=list_create_2)

# group: Get Wall Direction
code_block_3 = CodeBlock { "Direction X"; }
getLocation = Element.GetLocation(element=all_elements_of_category)
direction = Line.Direction(line=getLocation)
X = Vector.X(vector=direction)
list_create_3 = List.Create(item0=code_block_3, item1=X)
flatten_3 = List.Flatten(list=list_create_3)
code_block_4 = CodeBlock { "Direction Y"; }
Y = Vector.Y(vector=direction)
list_create_4 = List.Create(item0=code_block_4, item1=Y)
flatten_4 = List.Flatten(list=list_create_4)

# group: Get Wall Start Point
code_block_5 = CodeBlock { "Start Point X"; }
getLocation_2 = Element.GetLocation(element=all_elements_of_category)
startPoint = Curve.StartPoint(curve=getLocation_2)
X_2 = Point.X(point=startPoint)
list_create_5 = List.Create(item0=code_block_5, item1=X_2)
flatten_5 = List.Flatten(list=list_create_5)
code_block_6 = CodeBlock { "Start Point Y"; }
Y_2 = Point.Y(point=startPoint)
list_create_6 = List.Create(item0=code_block_6, item1=Y_2)
flatten_6 = List.Flatten(list=list_create_6)

list_create_7 = List.Create(item0=flatten, item1=flatten_2, item2=flatten_3, item3=flatten_4, item4=flatten_5, item5=flatten_6)
transpose = List.Transpose(lists=list_create_7)
exportCSV = Data.ExportCSV(filePath=file_path, data=transpose)
