# Dynamo graph dynamo wall extraction.dyn (Dynamo 2.18.1.5096)

file_path = Filename("D:\ARG\Documentation\Projects\GAMMA\Revit\wall_center.csv")
categories = Categories("OST_Walls")
all_elements_of_category = ElementsOfCategory(Category=categories)
boundingBox = Element.BoundingBox(element=all_elements_of_category)
toCuboid = BoundingBox.ToCuboid(boundingBox=boundingBox)
centroid = Solid.Centroid(solid=toCuboid)
exportCSV = Data.ExportCSV(filePath=file_path, data=centroid)
file_path_2 = Filename(".\walls_with_id.csv")
code_block = CodeBlock { ["ID", "Start Point X", "Start Point Y", "Start Point Z", "End Point X", "End Point Y", "End Point Z", "Direction X", "Direction Y", "Direction Z", "Length"]; }
categories_2 = Categories("OST_Walls")
all_elements_of_category_2 = ElementsOfCategory(Category=categories_2)
id = Element.Id(element=all_elements_of_category_2)
getLocation = Element.GetLocation(element=all_elements_of_category_2)
list_create = List.Create(item0=id, item1=getLocation)
transpose = List.Transpose(lists=list_create)
addItemToFront = List.AddItemToFront(item=code_block, list=transpose)
exportCSV_2 = Data.ExportCSV(filePath=file_path_2, data=addItemToFront)
getLocation_2 = Element.GetLocation(element=all_elements_of_category)
