# Dynamo graph wall deviation painting.dyn (Dynamo 2.18.1.5096)

# group: Get Deviations
file_path = Filename("csv\walls_data_with_reality.csv")
importCSV = Data.ImportCSV(filePath=file_path)
code_block = CodeBlock { 6; }
getItemAtIndex = List.GetItemAtIndex(list=importCSV, index=code_block)

# group: Get Ids
file_path_2 = Filename("csv\walls_data_with_reality.csv")
importCSV_2 = Data.ImportCSV(filePath=file_path)
code_block_2 = CodeBlock { 0; }
getItemAtIndex_2 = List.GetItemAtIndex(list=importCSV_2, index=code_block_2)
code_block_3 = CodeBlock { 1; }
count = List.Count(list=getItemAtIndex_2)
slice = List.Slice(list=getItemAtIndex_2, start=code_block_3, end=count)

# group: Get Walls with Larger Deviation Values
code_block_4 = CodeBlock { 0.05; }
gt = getItemAtIndex > code_block_4
code_block_5 = CodeBlock { 1; }
count_2 = List.Count(list=gt)
slice_2 = List.Slice(list=gt, start=code_block_5, end=count_2)

# group: Filter Ids with Larger Deviations
filterByBoolMask = List.FilterByBoolMask(list=slice, mask=slice_2)
list_create = List.Create(item0=filterByBoolMask.in)

# group: Color Element by ID
element_by_id = ElementById(Id=list_create)
color_palette = ColorPalette({R: 255, G: 0, B: 0, A: 255})
overrideColorInView = Element.OverrideColorInView(element=element_by_id, color=color_palette)

# group: Filter Ids with Small Deviations
filterByBoolMask_2 = List.FilterByBoolMask(list=slice, mask=slice_2)
list_create_2 = List.Create(item0=filterByBoolMask_2.out)

# group: Color Element by ID
element_by_id_2 = ElementById(Id=list_create_2)
color_palette_2 = ColorPalette({R: 125, G: 255, B: 2, A: 255})
overrideColorInView_2 = Element.OverrideColorInView(element=element_by_id_2, color=color_palette_2)

# group: Set Deviation Parameter to Project
code_block_6 = CodeBlock { "Deviation"; }
code_block_7 = CodeBlock { "Ananlysis"; }
spec_types = SpecTypes("autodesk.spec.aec:number")
group_types = GroupTypes("autodesk.revit.group:energyAnalysisBuildingData")
code_block_8 = CodeBlock { true; }
createProjectParameterForAllCategories = Parameter.CreateProjectParameterForAllCategories(parameterName=code_block_6, groupName=code_block_7, specType=spec_types, groupType=group_types, instance=code_block_8)

# group: Set Deviation Values
file_path_3 = Filename("csv\walls_data_with_reality.csv")
importCSV_3 = Data.ImportCSV(filePath=file_path_3)
code_block_9 = CodeBlock { 0; }
getItemAtIndex_3 = List.GetItemAtIndex(list=importCSV_3, index=code_block_9)
code_block_10 = CodeBlock { 1; }
count_3 = List.Count(list=getItemAtIndex_3)
slice_3 = List.Slice(list=getItemAtIndex_3, start=code_block_10, end=count_3)
element_by_id_3 = ElementById(Id=slice_3)
code_block_11 = CodeBlock { "Deviation"; }
file_path_4 = Filename("csv\walls_data_with_reality.csv")
importCSV_4 = Data.ImportCSV(filePath=file_path_4)
code_block_12 = CodeBlock { 6; }
getItemAtIndex_4 = List.GetItemAtIndex(list=importCSV_4, index=code_block_12)
code_block_13 = CodeBlock { 1; }
slice_4 = List.Slice(list=getItemAtIndex_4, start=code_block_13, end=count_3)
setParameterByName = Element.SetParameterByName(element=element_by_id_3, parameterName=code_block_11, value=slice_4)
count_4 = List.Count(list=getItemAtIndex_4)

# group: Get Wall Point Cloud
file_path_5 = Filename("csv\wall_points.csv")
importCSV_5 = Data.ImportCSV(filePath=file_path_5)
code_block_14 = CodeBlock(data=importCSV_5)
# ---------- code_block_14.designscript (3 lines) ----------
dataTrans = DSCore.List.Transpose(data);
dropItems = DSCore.List.DropItems(dataTrans, 1);
dropItemsTrans = DSCore.List.Transpose(dropItems);
# ----------------------------------------
python_script_to_create_sublists = Python(IN[0]=code_block_14.dropItems)  # CPython3
# ---------- python_script_to_create_sublists.python (40 lines) ----------
# Load the Python Standard and DesignScript Libraries
import sys
import clr
clr.AddReference('ProtoGeometry')
from Autodesk.DesignScript.Geometry import *
import numpy as np

# The inputs to this node will be stored as a list in the IN variables.
dataEnteringNode = IN
data_array = np.array(dataEnteringNode)


# Place your code below this line
def split_list_by_id(data):
    ids = data[:, 0]  # First column with IDs
    unique_ids, indices = np.unique(ids, return_index=True)
    current_list = []
    sublists = []
    current_id = ids[0][0]
    capture_id =  current_id  
    
    for d in data:
        for id in d:
           if current_id != id[0]:
               current_id = id[0]
               sublists.append(current_list)
               current_list = []                          
               current_list.append(id.tolist())
           else:     
                current_list.append(id.tolist())
                
    sublists.append(current_list)                
                
    return capture_id, sublists

capture_id, sublists = split_list_by_id(data_array)


# Assign your output to the OUT variable.
OUT = sublists
# ----------------------------------------
python_script = Python(IN[0]=python_script_to_create_sublists)  # CPython3
# ---------- python_script.python (37 lines) ----------
# Load the Python Standard and DesignScript Libraries
import sys
import clr
clr.AddReference('ProtoGeometry')
from Autodesk.DesignScript.Geometry import *

# The inputs to this node will be stored as a list in the IN variables.
sublists  = IN

# Output list to store points
output_points = []
output_spheres = []

# Loop through each sublist
plane = []
for sublist in sublists:
    # List to store points for current sublist
    points = []
    spheres = []


    # Loop through each point in the sublist
    for row in sublist:
        for point in row:
            id, x, y, z = point
            # Create a point using the XYZ coordinates
            pt = Point.ByCoordinates(x, y, z)
            points.append(pt)
            sp = Sphere.ByCenterPointRadius(pt, 0.05)
            spheres.append(sp)
            
    # Add the points for the current sublist to the output list
    output_points.append(points)
    output_spheres.append(spheres)

# Output the list of points
OUT = output_spheres
# ----------------------------------------
byGeometries = ImportInstance.ByGeometries(geometries=python_script)
color_palette_3 = ColorPalette({R: 0, G: 77, B: 38, A: 255})
byGeometryColor = Modifiers.GeometryColor.ByGeometryColor(geometry=python_script, color=color_palette_3)
