# Dynamo graph wall drawing.dyn (Dynamo 2.18.1.5096)

# group: Draw Single Wall Surfaces
file_path = Filename("F:\wall_surfaces.csv")
importCSV = Data.ImportCSV(filePath=file_path, transpose=file_path)
code_block = CodeBlock(data=importCSV) { dropItems=DSCore.List.DropItems(data, 1); dataTrans=DSCore.List.Transpose(dropItems); }
code_block_2 = CodeBlock(dataTrans=code_block.dataTrans)
# ---------- code_block_2.designscript (12 lines) ----------
ids= dataTrans[0];
level=dataTrans[1];

startPoint_x=dataTrans[2];
startPoint_y=dataTrans[3];
startPoint_z=dataTrans[4];

endPoint_x=dataTrans[5];
endPoint_y=dataTrans[6];
endPoint_z=dataTrans[7];

height=dataTrans[9];
# ----------------------------------------
byCoordinates = Point.ByCoordinates(x=code_block_2.startPoint_x, y=code_block_2.startPoint_y, z=code_block_2.startPoint_z)
byCoordinates_2 = Point.ByCoordinates(x=code_block_2.endPoint_x, y=code_block_2.endPoint_y, z=code_block_2.endPoint_z)
byStartPointEndPoint = Line.ByStartPointEndPoint(startPoint=byCoordinates, endPoint=byCoordinates_2)
levels = Levels("L2")
wall_types = WallTypes("Generic - 100mm Brick")
byCurveAndHeight = Wall.ByCurveAndHeight(curve=byStartPointEndPoint, height=code_block_2.height, level=levels, wallType=wall_types)

# group: Draw Wall 200mm
file_path_2 = Filename("F:\walls.csv")
importCSV_2 = Data.ImportCSV(filePath=file_path_2, transpose=file_path_2)
code_block_3 = CodeBlock(data=importCSV_2) { dropItems=DSCore.List.DropItems(data, 1); dataTrans=DSCore.List.Transpose(dropItems); }
code_block_4 = CodeBlock(dataTrans=code_block_3.dataTrans)
# ---------- code_block_4.designscript (13 lines) ----------
ids= dataTrans[0];
level=dataTrans[1];

startPoint_x=dataTrans[2];
startPoint_y=dataTrans[3];
startPoint_z=dataTrans[4];

endPoint_x=dataTrans[5];
endPoint_y=dataTrans[6];
endPoint_z=dataTrans[7];

height=dataTrans[9];
thickness=dataTrans[10];
# ----------------------------------------
byCoordinates_3 = Point.ByCoordinates(x=code_block_4.startPoint_x, y=code_block_4.startPoint_y, z=code_block_4.startPoint_z)
byCoordinates_4 = Point.ByCoordinates(x=code_block_4.endPoint_x, y=code_block_4.endPoint_y, z=code_block_4.endPoint_z)
byStartPointEndPoint_2 = Line.ByStartPointEndPoint(startPoint=byCoordinates_3, endPoint=byCoordinates_4)
code_block_5 = CodeBlock(data1=code_block_4.thickness) { data1<0.2 && data1>0.10; }
filterByBoolMask = List.FilterByBoolMask(list=byStartPointEndPoint_2, mask=code_block_5)
levels_2 = Levels("L2")
wall_types_2 = WallTypes("Generic - 200mm Masonry")
byCurveAndHeight_2 = Wall.ByCurveAndHeight(curve=filterByBoolMask.in, height=code_block_4.height, level=levels_2, wallType=wall_types_2)

# group: Draw Wall 300mm
file_path_3 = Filename("F:\walls.csv")
importCSV_3 = Data.ImportCSV(filePath=file_path_3, transpose=file_path_3)
code_block_6 = CodeBlock(data=importCSV_3) { dropItems=DSCore.List.DropItems(data, 1); dataTrans=DSCore.List.Transpose(dropItems); }
code_block_7 = CodeBlock(dataTrans=code_block_6.dataTrans)  # same code as code_block_4
byCoordinates_5 = Point.ByCoordinates(x=code_block_7.startPoint_x, y=code_block_7.startPoint_y, z=code_block_7.startPoint_z)
byCoordinates_6 = Point.ByCoordinates(x=code_block_7.endPoint_x, y=code_block_7.endPoint_y, z=code_block_7.endPoint_z)
byStartPointEndPoint_3 = Line.ByStartPointEndPoint(startPoint=byCoordinates_5, endPoint=byCoordinates_6)
code_block_8 = CodeBlock(data1=code_block_7.thickness) { data1<0.3 && data1>0.20; }
filterByBoolMask_2 = List.FilterByBoolMask(list=byStartPointEndPoint_3, mask=code_block_8)
levels_3 = Levels("L2")
wall_types_3 = WallTypes("Generic - 300mm Masonry")
byCurveAndHeight_3 = Wall.ByCurveAndHeight(curve=filterByBoolMask_2.in, height=code_block_7.height, level=levels_3, wallType=wall_types_3)

# group: Draw Wall 450 mm
file_path_4 = Filename("F:\walls.csv")
importCSV_4 = Data.ImportCSV(filePath=file_path_4, transpose=file_path_4)
code_block_9 = CodeBlock(data=importCSV_4) { dropItems=DSCore.List.DropItems(data, 1); dataTrans=DSCore.List.Transpose(dropItems); }
code_block_10 = CodeBlock(dataTrans=code_block_9.dataTrans)  # same code as code_block_4
byCoordinates_7 = Point.ByCoordinates(x=code_block_10.startPoint_x, y=code_block_10.startPoint_y, z=code_block_10.startPoint_z)
byCoordinates_8 = Point.ByCoordinates(x=code_block_10.endPoint_x, y=code_block_10.endPoint_y, z=code_block_10.endPoint_z)
byStartPointEndPoint_4 = Line.ByStartPointEndPoint(startPoint=byCoordinates_7, endPoint=byCoordinates_8)
code_block_11 = CodeBlock { data>0.4 && data<0.6; }  # unwired: data
filterByBoolMask_3 = List.FilterByBoolMask(list=byStartPointEndPoint_4, mask=code_block_11)
levels_4 = Levels("L2")
wall_types_4 = WallTypes("Concrete 450mm")
byCurveAndHeight_4 = Wall.ByCurveAndHeight(curve=filterByBoolMask_3.in, height=code_block_10.height, level=levels_4, wallType=wall_types_4)

# group: Draw Wall 600 mm
file_path_5 = Filename("F:\walls.csv")
importCSV_5 = Data.ImportCSV(filePath=file_path_5, transpose=file_path_5)
code_block_12 = CodeBlock(data=importCSV_5) { dropItems=DSCore.List.DropItems(data, 1); dataTrans=DSCore.List.Transpose(dropItems); }
code_block_13 = CodeBlock(dataTrans=code_block_12.dataTrans)  # same code as code_block_4
byCoordinates_9 = Point.ByCoordinates(x=code_block_13.startPoint_x, y=code_block_13.startPoint_y, z=code_block_13.startPoint_z)
byCoordinates_10 = Point.ByCoordinates(x=code_block_13.endPoint_x, y=code_block_13.endPoint_y, z=code_block_13.endPoint_z)
byStartPointEndPoint_5 = Line.ByStartPointEndPoint(startPoint=byCoordinates_9, endPoint=byCoordinates_10)
code_block_14 = CodeBlock { data>0.6; }  # unwired: data
filterByBoolMask_4 = List.FilterByBoolMask(list=byStartPointEndPoint_5, mask=code_block_14)
levels_5 = Levels("L2")
wall_types_5 = WallTypes("Concrete 600mm")
byCurveAndHeight_5 = Wall.ByCurveAndHeight(curve=filterByBoolMask_4.in, height=code_block_13.height, level=levels_5, wallType=wall_types_5)
