# Dynamo graph wall points drawing.dyn (Dynamo 2.18.1.5096)

# group: Get X Wall Surface Point Cloud
file_path = Filename("F:\s_graphs_data_2024-8_17_10_19_51\x_vert_planes\plane_points.csv")
importCSV = Data.ImportCSV(filePath=file_path)
code_block = CodeBlock(data=importCSV)
# ---------- code_block.designscript (3 lines) ----------
dataTrans = DSCore.List.Transpose(data);
dropItems = DSCore.List.DropItems(dataTrans, 1);
dropItemsTrans = DSCore.List.Transpose(dropItems);
# ----------------------------------------
python_script_to_create_sublists = Python(IN[0]=code_block.dropItems)  # CPython3
# ---------- python_script_to_create_sublists.python (40 lines) ----------
# Load the Python Standard and DesignScript Libraries
import sys
import clr
clr.AddReference('ProtoGeometry')
from Autodesk.DesignScript.Geometry import *
import numpy as np

# The inputs to this node will be stored as a list in the IN variables.
dataEnteringNode = IN
data_array = np.array(dataEnteringNode)


# Place your code below this line
def split_list_by_id(data):
    ids = data[:, 0]  # First column with IDs
    unique_ids, indices = np.unique(ids, return_index=True)
    current_list = []
    sublists = []
    current_id = ids[0][0]
    capture_id =  current_id  
    
    for d in data:
        for id in d:
           if current_id != id[0]:
               current_id = id[0]
               sublists.append(current_list)
               current_list = []                          
               current_list.append(id.tolist())
           else:     
                current_list.append(id.tolist())
                
    sublists.append(current_list)                
                
    return capture_id, sublists

capture_id, sublists = split_list_by_id(data_array)


# Assign your output to the OUT variable.
OUT = sublists
# ----------------------------------------
python_script = Python(IN[0]=python_script_to_create_sublists)  # CPython3
# ---------- python_script.python (37 lines) ----------
# Load the Python Standard and DesignScript Libraries
import sys
import clr
clr.AddReference('ProtoGeometry')
from Autodesk.DesignScript.Geometry import *

# The inputs to this node will be stored as a list in the IN variables.
sublists  = IN

# Output list to store points
output_points = []
output_spheres = []

# Loop through each sublist
plane = []
for sublist in sublists:
    # List to store points for current sublist
    points = []
    spheres = []


    # Loop through each point in the sublist
    for row in sublist:
        for point in row:
            id, x, y, z = point
            # Create a point using the XYZ coordinates
            pt = Point.ByCoordinates(x, y, z)
            points.append(pt)
            sp = Sphere.ByCenterPointRadius(pt, 0.05)
            spheres.append(sp)
            
    # Add the points for the current sublist to the output list
    output_points.append(points)
    output_spheres.append(spheres)

# Output the list of points
OUT = output_points
# ----------------------------------------

# group: Get Y Wall Surface Point Cloud
file_path_2 = Filename("F:\s_graphs_data_2024-8_17_10_19_51\y_vert_planes\plane_points.csv")
importCSV_2 = Data.ImportCSV(filePath=file_path_2)
code_block_2 = CodeBlock(data=importCSV_2)  # same code as code_block
python_script_to_create_sublists_2 = Python(IN[0]=code_block_2.dropItems)  # CPython3; same code as python_script_to_create_sublists
python_script_2 = Python(IN[0]=python_script_to_create_sublists_2)  # CPython3; same code as python_script

# group: Get Walls Point Cloud
file_path_3 = Filename("F:\s_graphs_data_2024-8_17_10_19_51\walls\wall_points.csv")
importCSV_3 = Data.ImportCSV(filePath=file_path_3)
code_block_3 = CodeBlock(data=importCSV_3)  # same code as code_block
python_script_to_create_sublists_3 = Python(IN[0]=code_block_3.dropItems)  # CPython3; same code as python_script_to_create_sublists
python_script_3 = Python(IN[0]=python_script_to_create_sublists_3)  # CPython3; same code as python_script
watch = Watch(code_block_3.dropItems)
